# Grasshopper definition urbano_test_0000.ghx (Grasshopper 1.0.7)
# plug-ins: Urbano

panel = Panel("C:\Users\info\Documents\Rhinoceros\CorsoTix\Urbano\studio_tix.xml")
panel_2 = Panel("""41.899846
12.454267""")
panel_3 = Panel("""41.898150
12.457851""")
list_item = ListItem(List=panel_2, Index=0, Wrap=True)  # -> Item1, Item
list_item_2 = ListItem(List=panel_3, Index=0, Wrap=True)  # -> Item1, Item
download_openstreetmap_osm = DownloadOpenStreetMapOSM(
    LeftBound=list_item.Item1,
    RightBound=list_item_2.Item1,
    TopBound=list_item.Item,
    BottomBound=list_item_2.Item,
    FilePath=panel,
    RunToggle=Toggle(False))  # -> OSMQueryURL, OSMFilePath
panel_4 = Panel(download_openstreetmap_osm.OSMFilePath)
import_osm_features = ImportOSMFeatures(OSMPathOrURL=download_openstreetmap_osm.OSMFilePath, OSMFeatureType="street", Format="xml", ImportAltitude=False)  # -> Points, Metadata, UTMZone, TranslationVector
import_osm_features_2 = ImportOSMFeatures(OSMPathOrURL=download_openstreetmap_osm.OSMFilePath, OSMFeatureType="building", Format="xml", ImportAltitude=False)  # -> Points, Metadata, UTMZone, TranslationVector
import_osm_features_3 = ImportOSMFeatures(OSMPathOrURL=download_openstreetmap_osm.OSMFilePath, OSMFeatureType="amenity", Format="xml", ImportAltitude=False)  # -> Points, Metadata, UTMZone, TranslationVector
polyline = PolyLine(Vertices=import_osm_features.Points, Closed=True)
polyline_2 = PolyLine(Vertices=import_osm_features_2.Points, Closed=True)
tree_branch = TreeBranch(Tree=import_osm_features_3.Points, Path="{10}", MaintainPaths=True)
custom_preview = CustomPreview(Geometry=polyline, Material=ColourSwatch(SwatchColor=RGB(255, 255, 255)))
custom_preview_2 = CustomPreview(Geometry=polyline_2, Material=ColourSwatch(SwatchColor=RGB(0, 255, 8)))
create_building = CreateBuilding(BuildingCurve=polyline_2, Metadata=import_osm_features_2.Metadata, AmenitiesInBuilding=import_osm_features_3.Metadata)
create_street_network = CreateStreetNetwork(
    StreetCurves=flatten(polyline),
    Metadata=flatten(import_osm_features.Metadata),
    SplitStreetCurves=False,
    UTMZone=import_osm_features.UTMZone,
    TranslationVector=import_osm_features.TranslationVector)  # -> StreetNetwork, StreetSegmentCurves, UTMZone, TranslationVector
project_geographic_point = ProjectGeographicPoint(Point=tree_branch, Projection="UTM -> WSG84", UTMZone=import_osm_features_3.UTMZone)  # -> Out, UTMZone
panel_5 = Panel(project_geographic_point.Out)
project_geographic_point_2 = ProjectGeographicPoint(Point="{41.898955, 12.455591, 0}", Projection="UTM -> WSG84", UTMZone=import_osm_features_2.UTMZone)  # -> Out, UTMZone; disabled
build_urbano_model = BuildUrbanoModel(Buildings=flatten(create_building), StreetNetwork=create_street_network.StreetNetwork, BuildToggle=True)  # -> UrbanoModel, BuildingCurves, Activities
panel_6 = Panel(build_urbano_model.UrbanoModel)
